# Grasshopper definition example.gh (Grasshopper 1.0.7)
# plug-ins: Hops

number_slider = Slider(3, range=0..3)
number_slider_2 = Slider(8, range=4..8)
genes = GenePool(Decimals=2, Maximum=100, Minimum=0, Value=[45.39, 51.4, 46.53, 45.64, 19.75, 50.26, 47.55, 37.27, 38.92, 55.86])
hops = Hops(
    _Enabled=Toggle(True),
    Room_orient=Slider(-2, range=-2..2),
    Room_width=Slider(22, range=10..22),
    Room_depth=Slider(22, range=10..22),
    Alpha=Slider(1, range=0..5),
    Beta=Slider(0, range=0..5),
    CacheResultsInMemory=False,
    CacheSolveResults=False,
    RemoteDefinitionLocation="http://127.0.0.1:5000/optimize",
    RemoteSolveVersion=(0, 1, 0),
    ShowInput_Enabled=True,
    ShowInput_Path=False,
    SynchronousSolve=True)  # -> OptimizedSolarChimneyHeight, OptimizedSolarChimneyOrient, MinObjectiveResult, Flow_rate, TotalDiscomfortHours, TooHotDiscomfortHours, OT_TotalDiscomfortHours, OT_TooHotDiscomfortHours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
hops_2 = Hops(
    _Enabled=Toggle(True),
    SolarChimneyHeight=number_slider_2,
    SolarChimneyOrient=number_slider,
    Room_orient=Slider(-2, range=-2..2),
    Room_width=Slider(22, range=10..22),
    Room_depth=Slider(22, range=10..22),
    CacheResultsInMemory=True,
    CacheSolveResults=True,
    RemoteDefinitionLocation="http://127.0.0.1:5000/predict",
    RemoteSolveVersion=(0, 1, 0),
    ShowInput_Enabled=True,
    ShowInput_Path=False,
    SynchronousSolve=True)  # -> Flow_rate, TotalDiscomfortHours, TooHotDiscomfortHours, OT_TotalDiscomfortHours, OT_TooHotDiscomfortHours, NS_OT_TotalDiscomfortHours, NS_OT_TooHotDiscomfortHours, TotalEnergyUse, CoolingEnergyUSe
panel = Panel([hops.OptimizedSolarChimneyHeight, hops.OptimizedSolarChimneyOrient, hops.MinObjectiveResult])
panel_2 = Panel([hops.Flow_rate, hops.TotalDiscomfortHours, hops.TooHotDiscomfortHours, hops.OT_TotalDiscomfortHours, hops.OT_TooHotDiscomfortHours, hops.NS_OT_TotalDiscomfortHours, hops.NS_OT_TooHotDiscomfortHours, hops.TotalEnergyUse, hops.CoolingEnergyUSe])
panel_3 = Panel([hops_2.Flow_rate, hops_2.TotalDiscomfortHours, hops_2.TooHotDiscomfortHours, hops_2.OT_TotalDiscomfortHours, hops_2.OT_TooHotDiscomfortHours, hops_2.NS_OT_TotalDiscomfortHours, hops_2.NS_OT_TooHotDiscomfortHours, hops_2.TotalEnergyUse, hops_2.CoolingEnergyUSe])
galapagos = Galapagos(gene=[number_slider, number_slider_2, genes])
